# Grasshopper definition GeoOpt-02-Laura-Marsillo.gh (Grasshopper 1.0.7)

# Assignment 2
python = GhPythonScript(x=Slider(10, range=1..20), y=Slider(10, range=1..20), U=Slider(20, range=1..20), V=Slider(20, range=1..20))  # -> out, a, c, d, e, f, g, h; inputs x: Int32, U: Int32, V: Int32
# ---------- python: Python ----------
import Rhino.Geometry as rg
import ghpythonlib.treehelpers as th
import math
import ghpythonlib.components as ghc

#this is how you initialize a list in python
pointList1 = []
pointList2 = []
for i in range(x):
    pt1 = rg.Point3d(i, 0, 0)
    pt2 = rg.Point3d(i, y, 0)
    pointList1.append(pt1)
    pointList2.append(pt2)

a = pointList1

lineList = []
for i in range(len(pointList1)):
    line = rg.Line(pointList1[i], pointList2[i])
    lineList.append(line)
c = lineList


allDivPts = []
for l in lineList:
    divPts = [] #my list of division points
    nc = l.ToNurbsCurve()
    params = nc.DivideByCount(V, True)
    for p in params:
        divPt = nc.PointAt(p)
        
        vec= rg.Vector3d(divPt)
        vecLen = vec.Length
        mag = math.sin(vecLen)
        transVec = -rg.Vector3d.ZAxis * mag
        
        newPt = divPt - transVec
        divPts.append(newPt)

    allDivPts.append(divPts)

print(allDivPts)
d = th.list_to_tree(allDivPts)


#make a curve from list of points
curveList = []
for i in range(len(allDivPts)):
    curve = rg.Curve.CreateInterpolatedCurve(allDivPts[i], 3)
    curveList.append(curve)
e= curveList


#create a loft surface from curves
surface = rg.Brep.CreateFromLoft(curveList, rg.Point3d.Unset, rg.Point3d.Unset, rg.LoftType.Normal, False)
surface = surface[0].Faces[0]

f = surface

#reparametrize surface
surface.SetDomain(0,rg.Interval(0,U))
surface.SetDomain(1,rg.Interval(0,V))

#get points
allSrfPts=[]
for i in range(U+1):
    srfPts= []
    for j in range(V+1):
        pt=rg.Surface.PointAt(surface,i,j)
        srfPts.append(pt)
    allSrfPts.append(srfPts)
h = allSrfPts


mesh = rg.Mesh()
for i in range(len(allSrfPts)-1):
    for j in range(len(allSrfPts[i])-1):
        m = rg.Mesh()
        v1 = allSrfPts[i][j]
        v2 = allSrfPts[i][j+1]        
        v3 = allSrfPts[i+1][j+1]        
        v4 = allSrfPts[i+1][j]
        
        m.Vertices.Add(v1)
        m.Vertices.Add(v2)
        m.Vertices.Add(v3)
        m.Vertices.Add(v4)
        
        m.Faces.AddFace(0,1,2,3)
        
        mesh.Append(m)

g = mesh

cleanmesh = mesh
#methods to clean a mesh
cleanmesh.Normals.ComputeNormals()
cleanmesh.Vertices.CombineIdentical(True, True)
cleanmesh.Vertices.CullUnused()
cleanmesh.Weld(3.14159265358979)
cleanmesh.UnifyNormals()
cleanmesh.FaceNormals.ComputeFaceNormals()
cleanmesh.Compact()


h = cleanmesh
# ---------- end python ----------

# ---- group: create sun Vector
python_2 = GhPythonScript(x=Slider(0.8, range=0..1), y=Slider(1, range=0..1))  # -> out, a, b, c
# ---------- python_2: Python ----------
import Rhino.Geometry as rg
import math

#create a sun vector

#1. create a Sphere at point (0,0,0) with radius 1 and output it to a
#output the sphere to a

origin= rg.Point3d(0,0,0)
sphere= rg.Sphere(origin,1.0)
a = sphere


#2. evaluate a point in the sphere using rg.Sphere.PointAt() at coordintes x and y
#the point should only be on the upper half of the sphere (upper hemisphere)
#the angles are in radians, so you might want to use math.pi for this
#output the point to b

a = rg.Sphere.ToNurbsSurface(a)
domain = rg.Surface.SetDomain(a, 0, rg.Interval(0,1))
print(domain)

point=rg.Surface.PointAt(a,x,y)

b = point



#create a vector from the origin  and reverse the vector
#keep in mind that Reverse affects the original vector
#output the vector to c

vec1= rg.Vector3d(origin)
vec2= rg.Vector3d(b)
vecO=  rg.Vector3d.Add(vec1,vec2)

vec= rg.Vector3d.Negate(vecO)

c = vec



"""
rg.sphere.pointAt(x*2*math.pi, y*math.pi)

"""
# ---------- end python_2 ----------

# ---- group: replaceable mesh
mesh = Data(python.h)

# ----
srf = Surface(python_2.a)
pt = Point(python_2.b)

# ---- group: file a02
path = FilePath("D:\LAURA_\_APPLICATION\IAAC\MaCad\S3_Geo.opt\GeoOpt\GeoOpt\a02\a02.py")

# ----
medges = MeshEdges(Mesh=mesh)  # -> NakedEdges, InteriorEdges, NonManifoldEdges
vdis = VectorDisplay(Anchor=python_2.b, Vector=python_2.c)
file = ReadFile(File=path, PerLineParse=False)
python_3 = GhPythonScript(m=mesh, s=python_2.c, max_off=Slider(0.2, range=0..1), min_off=Slider(0.08, range=0..1))  # -> out, a, b, c, d, e, f, moved_faces, panels_with_openings; inputs m: Mesh, s: Vector3d
# ---------- python_3: Python ----------
"""Provides a scripting component.
    Inputs:
        m: a mesh
        s: sun vector
    Output:
        a: List of Vectors
        b: List of Points
        c: list of angles
        d: exploded mesh
        """
        

import Rhino.Geometry as rg
import Rhino.Geometry as rg
import ghpythonlib.treehelpers as th
import math
import ghpythonlib.components as ghc


#1.
#compute face normals using rg.Mesh.FaceNormals.ComputeFaceNormals()
#output the vectors to a

meshFaces=[]
faces= len(m.Faces)
for j in range(faces):
    mesh= m.FaceNormals[j]
    vector= rg.Vector3d(mesh)
    vector_reverse= vector.Negate(vector)
    meshFaces.append(vector_reverse)

a=meshFaces
print(a)




#2.
#get the centers of each faces using rg.Mesh.Faces.GetFaceCenter()
#store the centers into a list called centers 
#output that list to b


centers = []

for i in range(faces):
    center = m.Faces.GetFaceCenter(i)
    centers.append(center)

b = centers



#3.
#calculate the angle between the sun and each FaceNormal using rg.Vector3d.VectorAngle()
#store the angles in a list called angleList and output it to c

angleList=[]

for i in range(faces):
    angle= rg.Vector3d.VectorAngle(a[i],s)
    angleList.append(angle)

c = angleList




#4. explode the mesh - convert each face of the mesh into a mesh
#for this, you have to first copy the mesh using rg.Mesh.Duplicate()
#then iterate through each face of the copy, extract it using rg.Mesh.ExtractFaces
#and store the result into a list called exploded in output d



exploded=[]

copy_mesh= rg.Mesh.Duplicate(m)

copy_m= len(copy_mesh.Faces)

#print(copy_m)
#print(copy_mesh)

for i in range(copy_m):
    extract_faces= copy_mesh.Faces.ExtractFaces([0])
    exploded.append(extract_faces)


d = exploded

#after here, your task is to apply a transformation to each face of the mesh
#the transformation should correspond to the angle value that corresponds that face to it... 
#the result should be a mesh that responds to the sun position... its up to you!




# I am trying to move the mesh faces in relation to the sun vector and scale them in relation to the angle value 
#SUPPORT WITH DAI

#0 Remap angle values to control the range of the scale
remaped_angles=[]
min_offset=min_off
max_offset=max_off #reverse
for i in angleList:
    remaped = ( (i - min(angleList)) / (max(angleList) - min(angleList)) ) * (max_offset - min_offset) + min_offset
    remaped_angles.append(remaped)


#1.move faces in relation to sun vector
moved_faces=[]

for i in range(len(exploded)):
    face=rg.Mesh.Duplicate(exploded[i])
    vector = s+rg.Vector3d(a[i])/200
    moved=rg.Mesh.Transform(face,rg.Transform.Translation(-vector/8)) #gives true/false
    moved_faces.append(face)



#2.scale faces in relation to angle value
#2.1 Get faces outlines
moved_outlines=[]
for i in moved_faces:
    FaceOutlines=rg.Mesh.GetNakedEdges(i)
    moved_outlines.append(FaceOutlines)


#2.2 Convert to curves and Join
joined_moved=[]
for i in range(len(moved_outlines)):
    curves=[]
    for j in range(len(moved_outlines[i])):
        #convert to nurbs curve
        curve=rg.Polyline.ToNurbsCurve(moved_outlines[i][j])
        curves.append(curve)
    joined_curves=rg.NurbsCurve.JoinCurves(curves)[0]
    joined_moved.append(joined_curves)


#2.3 Offset joined outlines
offset_outlines=[]
for i in range(len(joined_moved)):
    #convert mesh to surface
    face_points=rg.Mesh.Vertices.GetValue(moved_faces[i])
    surface=rg.NurbsSurface.CreateFromPoints([rg.Point3d(pt) for pt in face_points],2,2,2,2)#list_comprehension 
    offseted=rg.Curve.OffsetOnSurface(joined_moved[i],surface,remaped_angles[i],.001)[0]
    offset_outlines.append(offseted)
#########################
outlines=[]
for i in exploded:
    FaceOutlines=rg.Mesh.GetNakedEdges(i)
    outlines.append(FaceOutlines)
joined=[]
for i in range(len(outlines)):
    curves=[]
    for j in range(len(outlines[i])):
        #convert to nurbs curve
        curve=rg.Polyline.ToNurbsCurve(outlines[i][j])
        curves.append(curve)
    joined_curves=rg.NurbsCurve.JoinCurves(curves)[0]
    joined.append(joined_curves)


#2.4 Loft 
panels_with_openings=[]
for i in range(len(offset_outlines)):
    curves_list=[offset_outlines[i],joined[i]]
    lofted=rg.Brep.CreateFromLoft(curves_list,rg.Point3d.Unset,rg.Point3d.Unset,rg.LoftType.Normal,False)[0]
    panels_with_openings.append(lofted)









"""
move_point=[]

for i in centers:
    point_move=[]
    newPt= i - s
    point_move.append(newPt)
    move_point.append(point_move)

e = th.list_to_tree(move_point)


#Move vertices of mesh in relation to the sun vector
V_mesh=m.Vertices


print(V_mesh)
print(type(V_mesh))
print(len(V_mesh))


AllVert=[]
for i in V_mesh:
    vertix=[]
    v= rg.Point3d(i)
    move_pt= v - s
    vertix.append(move_pt)
    AllVert.append(vertix)

f = th.list_to_tree(AllVert)


#move face
"""
# ---------- end python_3 ----------
data = Data(python_3.moved_faces)
data_2 = Data(python_3.panels_with_openings)
vdis_2 = VectorDisplay(Anchor=python_3.b, Vector=python_3.a)
bnd = Bounds(Numbers=python_3.c)
dedomain = DeconstructDomain(Domain=bnd)  # -> Start, End
gradient = Gradient(
    LowerLimit=dedomain.Start,
    UpperLimit=dedomain.End,
    Parameter=python_3.c,
    stops=[0: RGB(234, 38, 0), 0.25: RGB(234, 126, 0), 0.5: RGB(254, 244, 84), 0.75: RGB(173, 203, 249), 1: RGB(75, 107, 169)])
preview = CustomPreview(Geometry=data_2, Material=gradient)
